# Dynamo graph room_schedue_revit2020.2.dyn (Dynamo 2.3.0.5885)
# packages: Clockwork for Dynamo 2.x 2.3.0, archi-lab.net 2020.22.1

# group: GATHERING ALL ROOMS IN MODEL
categories = Categories("OST_Rooms")
all_elements_of_category = ElementsOfCategory(Category=categories)

finishes = Custom[Room.Finishes](room=all_elements_of_category)  # package Clockwork for Dynamo 2.x; Returns all room bounding faces and their materials

# group: FINISH SEPERATOR
# note: (Clockwork for Dynamo 2.X, 2019)
# note: If there are multiple materials to be written as floor, wall, ceiling finishes, this node seperates these finishes with given expression. "and", "+" may be used.
# Such as, if there are walls in a room and their finishes are plaster and tile, wall finishes will be written as;
# Plaster "designated seperator" Tile
string_finish_seperator = StringInput("and")  # graph input

# group: WALL FINISHES
rooms = Watch(all_elements_of_category)
code_block = CodeBlock { "Wall"; " Finish"; }
concat = String.Concat(string0=code_block.out0, string1=code_block.out1)
room_finishes_finishmaterials = Watch(finishes.finishMaterials)
room_finishes_finishmaterials_2 = Watch(finishes.elements)
string_from_object = FromObject(obj=room_finishes_finishmaterials_2)
contains = String.Contains(str=string_from_object, searchFor=code_block.out0)
filterByBoolMask = List.FilterByBoolMask(list=room_finishes_finishmaterials, mask=contains)
# note: from archi-lab.net
clear_list = Custom[Clear List](input=filterByBoolMask.in)  # package archi-lab.net; This node will remove all Null and Empty Lists from any list.
name = Material.Name(material=clear_list)
uniqueItems = List.UniqueItems(list=name@L2)
code_block_2 = CodeBlock(t=uniqueItems, a=string_finish_seperator) { b=List.Count(t); [a]; List.Cycle(a,b); }
join = String.Join(separator=code_block_2.out2, string0=uniqueItems)
flatten = List.Flatten(list=join)
count = List.Count(list=flatten)
code_block_3 = CodeBlock(x=count) { 0..x..#x+1; }
code_block_4 = CodeBlock { ""; }
code_block_5 = CodeBlock(X=flatten, Y=code_block_4) { X==Y; }
filterByBoolMask_2 = List.FilterByBoolMask(list=code_block_3, mask=code_block_5)
code_block_6 = CodeBlock { "-"; }
# note: from Clockwork
replaceItemAtIndex = Custom[List.ReplaceItemAtIndex+](seq=flatten, indices=filterByBoolMask_2.in, replacement=code_block_6)  # package Clockwork for Dynamo 2.x; Replaces the item at a given index of a list by another item. Unlike the OOTB node, it can replace items at multiple indeces.
setParameterByName = Element.SetParameterByName(element=rooms, parameterName=concat, value=replaceItemAtIndex)

# group: FLOOR FINISHES;
watch = Watch(all_elements_of_category)
code_block_7 = CodeBlock { "Floor"; " Finish"; }
concat_2 = String.Concat(string0=code_block_7.out0, string1=code_block_7.out1)
code_block_8 = CodeBlock(a=string_finish_seperator) { [a]; }
# note: Instead of ceilings (refers to Revit ceilings) rooms may have floors to be written as ceiling finish. To write these finishes, floors in a room compared to their relative elevation. Floors that are located on lower elevations accepted as floor finishes, the others are ceiling finishes.
room_finishes_finishmaterials_3 = Watch(finishes.finishMaterials)
room_finishes_elements = Watch(finishes.elements)
string_from_object_2 = FromObject(obj=room_finishes_elements)
contains_2 = String.Contains(str=string_from_object_2, searchFor=code_block_7.out0)
filterByBoolMask_3 = List.FilterByBoolMask(list=room_finishes_finishmaterials_3, mask=contains_2)
watch_2 = Watch(filterByBoolMask_3.in)
filterByBoolMask_4 = List.FilterByBoolMask(list=room_finishes_elements, mask=contains_2)
# note: from Clockwork
level = Custom[Element.Level](element=filterByBoolMask_4.in@L2)  # package Clockwork for Dynamo 2.x; Gets an element's level
plane = Custom[Level.Plane](level=level)  # package Clockwork for Dynamo 2.x; Retrieves the plane of a given level
# note: Floors in a room compared to their relative elevation. Floors that are located on lower elevations accepted as floor finishes, the others are ceiling finishes.
origin = Plane.Origin(plane=plane)
code_block_9 = CodeBlock(a=origin) { Point.Z(a); }
minimumItem = List.MinimumItem(list=code_block_9@L2, lacing=Longest)
eq = code_block_9 == minimumItem  # lacing=Longest
filterByBoolMask_5 = List.FilterByBoolMask(list=watch_2, mask=eq)
name_2 = Material.Name(material=filterByBoolMask_5.in)
code_block_10 = CodeBlock { ""; }
code_block_11 = CodeBlock { "-"; }

uniqueItems_2 = List.UniqueItems(list=name_2@L2)

# group (continued): FLOOR FINISHES;
join_2 = String.Join(separator=code_block_8, string0=uniqueItems_2)
# note: If there are empty values in the list, indices of these values are defined. Then these values are replaced with hypen (-).
flatten_2 = List.Flatten(list=join_2)
count_2 = List.Count(list=join_2@L2)
code_block_12 = CodeBlock(x=count_2) { 0..x..#x+1; }
flatten_3 = List.Flatten(list=code_block_12)
code_block_13 = CodeBlock(X=join_2, Y=code_block_10) { X==Y; }

flatten_4 = List.Flatten(list=code_block_13)

# group (continued): FLOOR FINISHES;
filterByBoolMask_6 = List.FilterByBoolMask(list=flatten_3, mask=flatten_4)
flatten_5 = List.Flatten(list=filterByBoolMask_6.in)
replaceItemAtIndex_2 = Custom[List.ReplaceItemAtIndex+](seq=flatten_2, indices=flatten_5, replacement=code_block_11)
count_3 = List.Count(list=replaceItemAtIndex_2)
code_block_14 = CodeBlock(x=count_3) { 0..x-1..#x; }
# note: If there are null values in the list, indices of these values are defined. Then these values are replaced with hypen (-).
isNull = Object.IsNull(obj=replaceItemAtIndex_2)
filterByBoolMask_7 = List.FilterByBoolMask(list=code_block_14, mask=isNull)

# note: from Clockwork
replaceItemAtIndex_3 = Custom[List.ReplaceItemAtIndex+](seq=replaceItemAtIndex_2, indices=filterByBoolMask_7.in, replacement=code_block_11)

# group (continued): FLOOR FINISHES;
flatten_6 = List.Flatten(list=replaceItemAtIndex_3)
setParameterByName_2 = Element.SetParameterByName(element=watch, parameterName=concat_2, value=flatten_6)

# group: UPPER FLOOR, ROOF, CEILING FINISHES;
code_block_15 = CodeBlock(a=string_finish_seperator) { [a]; }
join_3 = List.Join()  # unwired: list0, list1
# note: After comparison of floors in a room, floors are located on upper elevation are collected to be written as ceiling finishes.
watch_3 = Watch(filterByBoolMask_5.out)
name_3 = Material.Name(material=watch_3, lacing=Longest)
room_finishes_finishmaterials_4 = Watch(finishes.finishMaterials)
room_finishes_elements_2 = Watch(finishes.elements)
string_from_object_3 = FromObject(obj=room_finishes_elements_2)
# note: To filter ceilings and roofs together, String.Contains node from archilab is used.
code_block_16 = CodeBlock { ["Ceiling","Roof"]; }
contains_3 = Custom[String.Contains](stringList=string_from_object_3@L2, filterList=code_block_16)  # package archi-lab.net; This node takes a list of strings and checks if any string contains a matching string from filter input.
filterByBoolMask_8 = List.FilterByBoolMask(list=room_finishes_finishmaterials_4, mask=contains_3)
watch_4 = Watch(filterByBoolMask_8.in)
# note: To prevent duplication of finishes List.UniqueItems node is used.
name_4 = Material.Name(material=watch_4@L2, lacing=Longest)
# note: To prevent duplication of same finishes, List.UniqueItems node is used.
uniqueItems_3 = List.UniqueItems(list=name_4@L2)
code_block_17 = CodeBlock { ""; }
code_block_18 = CodeBlock { "-"; }
watch_5 = Watch(all_elements_of_category)
code_block_19 = CodeBlock { "Ceiling Finish"; }

string_from_object_4 = FromObject(obj=code_block_15)
uniqueItems_4 = List.UniqueItems(list=name_3@L2)

# group (continued): UPPER FLOOR, ROOF, CEILING FINISHES;
combine = List.Combine(comb=join_3, list1=uniqueItems_4, list2=uniqueItems_3)

clear_list_2 = Custom[Clear List](input=combine)
string_from_object_5 = FromObject(obj=clear_list_2)

# group (continued): UPPER FLOOR, ROOF, CEILING FINISHES;
join_4 = String.Join(separator=string_from_object_4, string0=string_from_object_5)
flatten_7 = List.Flatten(list=join_4)
count_4 = List.Count(list=join_4@L2)
code_block_20 = CodeBlock(x=count_4) { 0..x-1..#x; }
# note: Null or empty values are replaced with -
flatten_8 = List.Flatten(list=code_block_20)
code_block_21 = CodeBlock(X=join_4, Y=code_block_17) { X==Y; }
flatten_9 = List.Flatten(list=code_block_21)
filterByBoolMask_9 = List.FilterByBoolMask(list=flatten_8, mask=flatten_9)
# note: from Clockwork
replaceItemAtIndex_4 = Custom[List.ReplaceItemAtIndex+](seq=flatten_7, indices=filterByBoolMask_9.in, replacement=code_block_18)

# group: OUTS
floor_finishes = Watch(flatten_6)  # graph output
wall_finishes = Watch(replaceItemAtIndex)  # graph output
ceiling_finishes = Watch(replaceItemAtIndex_4)  # graph output

replaceNull = Custom[List.ReplaceNull](seq=replaceItemAtIndex_4, replacement=code_block_18)  # package Clockwork for Dynamo 2.x; Replaces all null values within a given list with a substitute

# group (continued): UPPER FLOOR, ROOF, CEILING FINISHES;
setParameterByName_3 = Element.SetParameterByName(element=watch_5, parameterName=code_block_19, value=replaceNull)

watch_6 = Watch(finishes.elements)
